# Grasshopper definition MeshTests.gh (Grasshopper 1.0.7)
# Copyright: Alan Rynne
# plug-ins: Paramdigma Core Components

msphereex = MeshSphereEx(Base=PlaneXY(0, 0, 0), Radius=10, Count=5)
tri = Triangulate(Mesh=msphereex)  # -> Mesh, Count
he_mesh = HalfEdgeMesh(tri.Mesh)
pt = Point([Point(6.584510614, 0.1775610672, 0), Point(-9.746697591, 2.838332437, 23.81014395), Point(-2.0291972, 24.2080796, 0), Point(22.36720647, 20.06538897, 22.50589185)])
he_mesh_2 = HalfEdgeMesh(tri.Mesh)
item = ListItem(List=pt, Index=0, Wrap=True)  # -> Item, Item1, Item2, Item3
mesh = Mesh()
srf4pt = _4PointSurface(CornerA=item.Item, CornerB=item.Item1, CornerC=item.Item2, CornerD=item.Item3)
curvature = VertexCurvature(HalfEdgeMesh=he_mesh)  # -> K1, K2, K, Km
range = Range(Domain="-10 to 10", Steps=Slider(10, range=0..100))
he_mesh_3 = HalfEdgeMesh(srf4pt)
number_slider = Slider(5, range=0..10)
ortho = OrthonormalBasesComponent(HalfEdgeMesh=he_mesh)  # -> graft(E1), graft(E2)
level_sets = MeshLevelSets(HalfEdgeMesh=he_mesh, ScalarValues=curvature.Km, Levels=range)
gradient = MeshGradient(HalfEdgeMesh=he_mesh, ScalarValues=curvature.Km)
facen = FaceNormals(Mesh=tri.Mesh)  # -> Centers, Normals
vdisex = VectorDisplayEx(Point=graft(facen.Centers), Vector=unitize(graft(gradient)), Colour=RGB(0, 0, 0), Width=number_slider)
vdisex_2 = VectorDisplayEx(
    Point=graft(facen.Centers),
    Vector=[ortho.E1, ortho.E2],
    Colour=[ColourSwatch(SwatchColor=RGB(171, 194, 0)), ColourSwatch(SwatchColor=RGB(0, 120, 194))],
    Width=number_slider)
